# Grasshopper definition GHDebugSurface.gh (Grasshopper 1.0.7)

# ---- group: SurfaceFrom4Points
srf4pt = _4PointSurface(CornerA="{0.0, 0.0, 0.0}", CornerB="{10.0, 0.0, 0.0}", CornerC="{10.0, 10.0, 2.0}", CornerD="{0.0, 10.0, 4.0}")  # -> reparameterize(Surface)

# ---- group: SurfaceFromAGridOfPoints
srf = Surface(reparameterize(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))
srfpt = SurfacePoints(Surface=srf)  # -> Points, Weights, Greville, UCount, VCount

# ----
edges = BrepEdges(Brep=srf)  # -> Naked, Interior, NonManifold
srfpt_2 = SurfacePoints(Surface=srf4pt)  # -> Points, Weights, Greville, UCount, VCount
panel = Panel(srfpt.Points)
panel_2 = Panel(srfpt.Weights)
# All these definitions were used to convalidate and developed the GeometrySharp surfaces tests.
panel_3 = Panel(srfpt_2.Points)

# ---- group: Split
c_script = CSharpScript(srf=srf)  # -> out, bothSplits; inputs srf: Surface
# ---------- c_script: C# usings ----------
using System.Linq;
# ---------- c_script: C# ----------
    var split1 = srf.Split(1, 0.5);
    var srfs = split1.SelectMany(s => s.Split(0, 0.5)).ToList();
    bothSplits = srfs;
# ---------- end c_script ----------
c_script_2 = CSharpScript(srf=srf)  # -> out, surfsV, surfsU; inputs srf: Surface
# ---------- c_script_2: C# ----------
    surfsV = srf.Split(1, 0.5);
    surfsU = srf.Split(0, 0.5);
# ---------- end c_script_2 ----------
srfpt_3 = SurfacePoints(Surface=c_script.bothSplits)  # -> Points, Weights, Greville, UCount, VCount
srf_2 = Surface(reparameterize([c_script_2.surfsV, c_script_2.surfsU]))
srfpt_4 = SurfacePoints(Surface=c_script_2.surfsU)  # -> Points, Weights, Greville, UCount, VCount
srfpt_5 = SurfacePoints(Surface=c_script_2.surfsV)  # -> Points, Weights, Greville, UCount, VCount
panel_4 = Panel(srfpt_3.Points)
panel_5 = Panel(srfpt_5.Points)
panel_6 = Panel(srfpt_4.Points)
panel_7 = Panel(srfpt_5.UCount)
panel_8 = Panel(srfpt_5.VCount)
panel_9 = Panel(srfpt_4.UCount)
panel_10 = Panel(srfpt_4.VCount)
panel_11 = Panel(srfpt_3.Weights)
panel_12 = Panel(srfpt_4.Weights)
panel_13 = Panel(srfpt_5.Weights)
evalsrf = EvaluateSurface(Surface=reparameterize(c_script.bothSplits), Point="{0.5,0.5,0.0}")  # -> Point, Normal, UDirection, VDirection, Frame
evalsrf_2 = EvaluateSurface(Surface=srf_2, Point="{0.5,0.5,0.0}")  # -> Point, Normal, UDirection, VDirection, Frame
panel_14 = Panel(evalsrf.Point)
panel_15 = Panel(evalsrf_2.Point)

# ---- group: PointAt and VectorAt
panel_16 = Panel("""{0.5,0.5,0.0}
{0.1,0.1,0.0}
{1,1,0.0}
{0.3,0.5,0.0}""")
evalsrf_3 = EvaluateSurface(Surface=srf, Point=panel_16)  # -> Point, Normal, UDirection, VDirection, Frame
panel_17 = Panel(evalsrf_3.VDirection)
panel_18 = Panel(evalsrf_3.Point)

# ---- group: RationalDerivatives
c_script_3 = CSharpScript(srf=srf)  # -> out, derv0, dervs; inputs srf: Surface
# ---------- c_script_3: C# ----------
    Point3d pt;
    Vector3d[] derivis;
    srf.Evaluate(0.3, 0.5, 1, out pt, out derivis);
    dervs = derivis;
    derv0 = pt;
# ---------- end c_script_3 ----------
panel_19 = Panel(c_script_3.derv0)
panel_20 = Panel(c_script_3.dervs)

# ----
item = ListItem(List=c_script_3.dervs, Index=0, Wrap=True)
vdis = VectorDisplay(Anchor=c_script_3.derv0, Vector=item)

# ---- group: SurfaceIsocurve
c_script_4 = CSharpScript(srf=srf)  # -> out, isoV, isoU; inputs srf: Surface
# ---------- c_script_4: C# ----------
    isoV = srf.ToNurbsSurface().IsoCurve(1, 0.3);
    isoU = srf.ToNurbsSurface().IsoCurve(0, 0.3);
# ---------- end c_script_4 ----------
eval = EvaluateCurve(Curve=reparameterize(c_script_4.isoU), Parameter=0.5)  # -> Point, Tangent, Angle
cp = ControlPoints(Curve=c_script_4.isoU)  # -> Points, Weights, Knots
cp_2 = ControlPoints(Curve=c_script_4.isoV)  # -> Points, Weights, Knots
panel_21 = Panel(cp_2.Points)
panel_22 = Panel(cp_2.Weights)
panel_23 = Panel(cp.Points)
panel_24 = Panel(cp.Weights)
panel_25 = Panel(eval.Point)

# ---- group: ClosestPt and ClosestParameters
panel_26 = Panel("""{2.5, 7, 5}
{2.5, 1.5, 2}
{9, 2.5, 1}
{5, 5, 1}""")
pt = Point(panel_26)
c_script_5 = CSharpScript(testPt=pt, srf=srf)  # -> out, pt, uv; inputs testPt: Point3d, srf: Surface
# ---------- c_script_5: C# ----------
    Point3d ptAt;
    Vector3d[] derivs;
    double u; double v;
    srf.ClosestPoint(testPt, out u, out v);
    uv = new string[]{u.ToString(), v.ToString()};
    srf.Evaluate(u, v, 1, out ptAt, out derivs);
    pt = ptAt;
# ---------- end c_script_5 ----------
panel_27 = Panel(c_script_5.pt)
panel_28 = Panel(c_script_5.uv)
